# Grasshopper definition Comma Centre.ghx (Grasshopper 1.0.7)

number_slider = Slider(1850, range=0..2000)
number_slider_2 = Slider(6000, range=0..7000)
crv = Curve()

knob = ControlKnob(Decimals=0, Limit=True, Maximum=99, Minimum=0, Range=10, Value=2)
list = ValueList({"ALPHA": "ALPHA.a.", "Beta": "Beta.0.", "Stable": " "}, selected="ALPHA")
ver = VersionCreate(P="「Comma Centre」", D=[list, Slider(1, range=1..9)], V=Slider(1, range=0..9), D_2=knob)
panel = Panel(ver)

# ---- group: zhongting
crv_2 = Curve(<curve referenced from the Rhino model>)

# ----
panel_2 = Panel("""6000
3940
3440
0
0
6000
6000""")
panel_3 = Panel("""400
310
50
0
-500
-500
400""")
num = Number(number_slider)
pt = ConstructPoint(XCoordinate=0, YCoordinate=panel_2, ZCoordinate=panel_3)
pline = PolyLine(Vertices=pt, Closed=Toggle(True))
boundary = BoundarySurfaces(Edges=pline)
X = UnitX(Factor=num)
extr = Extrude(Base=boundary, Direction=X)

# ---- group: baojieshi
crv_3 = Curve(<curve referenced from the Rhino model>)

# ---- group: dianti1
crv_4 = Curve(<curve referenced from the Rhino model>)

# ----
pt_2 = ConstructPoint(XCoordinate=Slider(0, range=0..10000), YCoordinate=0, ZCoordinate=0)
吧台 = Curve(<curve referenced from the Rhino model>)

# ---- group: chufang
crv_5 = Curve(<curve referenced from the Rhino model>)

# ----
xy = XYPlane(Origin=pt_2)
cpoly = ControlPolygon(Curve=crv_3)  # -> Polygon, Points
crv_6 = Curve(<curve referenced from the Rhino model>)
crv_7 = Curve(<curve referenced from the Rhino model>)
crv_8 = Curve(<curve referenced from the Rhino model>)
panel_4 = Panel("""0
2""")
cpoly_2 = ControlPolygon(Curve=crv_4)  # -> Polygon, Points
rectangle = Rectangle(Plane=xy, XSize=number_slider, YSize=number_slider_2, Radius=0)  # -> Rectangle, Length
boundary_2 = BoundarySurfaces(Edges=crv_7)
panel_5 = Panel("""0
2""")
item = ListItem(List=cpoly.Points, Index=graft(panel_4), Wrap=True)
offset = OffsetCurve(Curve=crv_8, Distance=Slider(-40, range=-40..0), Corners=1)
Z = UnitZ(Factor=Slider(100, range=0..200))
boundary_3 = BoundarySurfaces(Edges=crv_6)
item_2 = ListItem(List=cpoly_2.Points, Index=graft(panel_5), Wrap=True)
boundary_4 = BoundarySurfaces(Edges=rectangle.Rectangle)
bang = ExplodeTree(Data=item)  # -> Branch0, Branch1
extr_2 = Extrude(Base=boundary_2, Direction=Z)
Z_2 = UnitZ(Factor=Slider(200, range=0..200))
boundary_5 = BoundarySurfaces(Edges=flatten([offset, crv_8]), UseTasks=True)
bang_2 = ExplodeTree(Data=item_2)  # -> Branch0, Branch1
Z_3 = UnitZ(Factor=Slider(340, range=0..400))
extr_3 = Extrude(Base=boundary_3, Direction=Z_2)
rec_2pt = Rectangle2Pt(Plane=crv_3, PointA=bang.Branch0, PointB=bang.Branch1, Radius=0)  # -> Rectangle, Length
Z_4 = UnitZ(Factor=Slider(1000, range=0..10000))
extr_4 = Extrude(Base=boundary_5, Direction=Z_3)
rec_2pt_2 = Rectangle2Pt(Plane=crv_4, PointA=bang_2.Branch0, PointB=bang_2.Branch1, Radius=Slider(4, range=0..10))  # -> Rectangle, Length
extr_5 = Extrude(Base=boundary_4, Direction=Z_4)
offset_2 = OffsetCurve(Curve=rec_2pt.Rectangle, Distance=Slider(-10, range=-40..0), Corners=1)

entwine = Entwine(Branch00=extr, FlattenInputs=True)
material = CreateMaterial(
    Diffuse=ColourSwatch(SwatchColor=RGB(128, 128, 128)),
    Specular=RGB(255, 254, 254),
    Emission=RGB(0, 0, 0),
    Transparency=Slider(0.45, range=0..1),
    Shine=0)
preview = CustomPreview(Geometry=entwine, Material=material)

boundary_6 = BoundarySurfaces(Edges=flatten([rec_2pt.Rectangle, offset_2]), UseTasks=True)
Z_5 = UnitZ(Factor=Slider(340, range=0..400))

number_slider_3 = Slider(1000, range=0..1000)
X_2 = UnitX(Factor=expr("-x", 1))
pt_3 = ConstructPoint(XCoordinate=0, YCoordinate=0, ZCoordinate=0)
line = LineSDL(Start=pt_3, Direction=X_2, Length=number_slider_3)
rectangle_2 = Rectangle(Plane=PlaneXY(0, 0, 0), XSize=Domain(-1, 1), YSize=Domain(-2, 2), Radius=0)  # -> Rectangle, Length
boundary_7 = BoundarySurfaces(Edges=rectangle_2.Rectangle)
division = Division(A=number_slider_3, B=Slider(4, range=2..8))
flip = Flip(Surface=boundary_7)  # -> Surface, Result
textsrf = TextOnSurface(
    Text=panel,
    Font="Futura Bold:no Italic:no",
    Height=division,
    Depth=Slider(20, range=0..50),
    BaseLine=line,
    BaseSurface=flip.Surface)
yz = YZPlane(Origin=Point(0, 0, 0))
xy_2 = XYPlane(Origin=Point(0, 0, 0))
X_3 = UnitX(Factor=1)
mirror = Mirror(Geometry=textsrf, Plane=yz)  # -> Geometry, Transform
rad = Radians(Degrees=Slider(37, range=0..90))
line_2 = LineSDL(Start=xy_2, Direction=X_3, Length=1)
rotax = RotateAxis(Geometry=mirror.Geometry, Angle=rad, Axis=line_2)  # -> Geometry, Transform
material_2 = CreateMaterial(
    Diffuse=ColourSwatch(SwatchColor=RGB(255, 254, 254)),
    Specular=RGB(255, 254, 254),
    Emission=RGB(0, 0, 0),
    Transparency=0,
    Shine=0)
preview_2 = CustomPreview(Geometry=rotax.Geometry, Material=material_2)

boundary_8 = BoundarySurfaces(Edges=flatten(rec_2pt_2.Rectangle), UseTasks=True)
extr_6 = Extrude(Base=boundary_6, Direction=Z_5)
Z_6 = UnitZ(Factor=Slider(300, range=0..400))
extr_7 = Extrude(Base=boundary_8, Direction=Z_6)

num_2 = Number(number_slider_2)
number_slider_4 = Slider(0, range=0..1000)
number_slider_5 = Slider(5, range=0..10)
number_slider_6 = Slider(1100, range=0..10000)
series = Series(Start=number_slider_4, Step=Slider(60, range=0..100), Count=number_slider_5)
Y = UnitY(Factor=series)
subtraction = Subtraction(A=num_2, B=number_slider_4)
rectangle_3 = Rectangle(Plane=Y, XSize=number_slider_6, YSize=subtraction, Radius=0)  # -> Rectangle, Length

# ---- group: fuzhuangshejibangongshi
crv_9 = Curve(<curve referenced from the Rhino model>)

# ----
edges = BrepEdges(Brep=crv_9)  # -> Naked, Interior, NonManifold

num_3 = Number(number_slider_2)
number_slider_7 = Slider(1200, range=0..6000)
number_slider_8 = Slider(5, range=0..10)
series_2 = Series(Start=number_slider_7, Step=Slider(60, range=0..100), Count=number_slider_8)
Y_2 = UnitY(Factor=series_2)
subtraction_2 = Subtraction(A=num_3, B=number_slider_7)
rectangle_4 = Rectangle(Plane=Y_2, XSize=Slider(1100, range=0..10000), YSize=subtraction_2, Radius=0)  # -> Rectangle, Length

boundary_9 = BoundarySurfaces(Edges=crv_9)
Z_7 = UnitZ(Factor=expr("-x", Slider(20, range=0..50)))
item_3 = ListItem(List=edges.Naked, Index=0, Wrap=True)
Y_3 = UnitY(Factor=Slider(60, range=0..200))
extr_8 = Extrude(Base=boundary_9, Direction=Z_7)
move = Move(Geometry=item_3, Motion=Y_3)  # -> Geometry, Transform
series_3 = Series(Start=0, Step=1, Count=Slider(5, range=0..10))
graph = GraphMapper(series_3, x0=0, x1=4, y0=0, y1=1, container_name="Bezier", cpx=[0, 0.1819527298, 0.8218189478, 1], cpy=[0, 0, 1, 1])
eval = EvaluateCurve(Curve=reparameterize(move.Geometry), Parameter=graph)  # -> Point, Tangent, Angle

num_4 = Number(number_slider_2)
number_slider_9 = Slider(2300, range=0..6000)
number_slider_10 = Slider(7, range=0..10)
series_4 = Series(Start=number_slider_9, Step=Slider(60, range=0..100), Count=number_slider_10)
Y_4 = UnitY(Factor=series_4)
subtraction_3 = Subtraction(A=num_4, B=number_slider_9)
rectangle_5 = Rectangle(Plane=Y_4, XSize=Slider(1100, range=0..10000), YSize=subtraction_3, Radius=0)  # -> Rectangle, Length

midpt = CurveMiddle(Curve=move.Geometry)
number_slider_11 = Slider(40, range=0..100)
number_slider_12 = Slider(28, range=0..100)
panel_6 = Panel("""1
2
3""")
shatter = Shatter(Curve=reparameterize(move.Geometry), Parameters=graph)
item_4 = ListItem(List=eval.Point, Index=panel_6, Wrap=True)
number_slider_13 = Slider(7, range=0..100)
dom = ConstructDomain(DomainStart=expr("-x", number_slider_12), DomainEnd=number_slider_12)
len = Length(Curve=shatter)
dom_2 = ConstructDomain(DomainStart=expr("-x", number_slider_11), DomainEnd=number_slider_11)
midpt_2 = CurveMiddle(Curve=shatter)
division_2 = Division(A=len, B="2")
rectangle_6 = Rectangle(Plane=item_4, XSize=dom, YSize=dom_2, Radius=0)  # -> Rectangle, Length
rad_2 = Radians(Degrees=Slider(20, range=0..90))
dom_3 = ConstructDomain(DomainStart=expr("-x", division_2), DomainEnd=division_2)
dom_4 = ConstructDomain(DomainStart=expr("-x", number_slider_13), DomainEnd=number_slider_13)
cos = Cosine(Value=rad_2)
tan = Tangent(Value=rad_2)
rectangle_7 = Rectangle(Plane=midpt_2, XSize=dom_3, YSize=dom_4, Radius=0)  # -> Rectangle, Length
multiplication = Multiplication(A="1", B=tan)
vec = VectorXYZ(XComponent=0, YComponent="1", ZComponent=multiplication)  # -> Vector, Length
boundary_10 = BoundarySurfaces(Edges=[rectangle_7.Rectangle, rectangle_6.Rectangle])
line_3 = LineSDL(Start=midpt, Direction=vec.Vector, Length=Slider(2824, range=0..5000))
extrcrv = ExtrudeAlong(Base=boundary_10, Curve=line_3)
vrayrender = VRayRender()
crv_10 = Curve(<curve referenced from the Rhino model>)
boundary_11 = BoundarySurfaces(Edges=crv_10)
Z_8 = UnitZ(Factor=Slider(1000, range=0..10000))
extr_9 = Extrude(Base=boundary_11, Direction=Z_8)

number_slider_14 = Slider(20, range=0..100)
series_5 = Series(Start=Slider(0, range=0..1000), Step=number_slider_14, Count=number_slider_5)
Z_9 = UnitZ(Factor=series_5)
move_2 = Move(Geometry=rectangle_3.Rectangle, Motion=Z_9)  # -> Geometry, Transform
Z_10 = UnitZ(Factor=number_slider_14)

bnd = Bounds(Numbers=series_5)
dedomain = DeconstructDomain(Domain=bnd)  # -> Start, End
addition = Addition(A=number_slider_14, B=dedomain.End)

boundary_12 = BoundarySurfaces(Edges=move_2.Geometry)

extr_10 = Extrude(Base=boundary_12, Direction=Z_10)

number_slider_15 = Slider(20, range=0..100)
series_6 = Series(Start=addition, Step=number_slider_15, Count=number_slider_8)
Z_11 = UnitZ(Factor=series_6)
move_3 = Move(Geometry=rectangle_4.Rectangle, Motion=Z_11)  # -> Geometry, Transform
Z_12 = UnitZ(Factor=number_slider_15)

bnd_2 = Bounds(Numbers=series_6)
dedomain_2 = DeconstructDomain(Domain=bnd_2)  # -> Start, End
addition_2 = Addition(A=number_slider_15, B=dedomain_2.End)

boundary_13 = BoundarySurfaces(Edges=move_3.Geometry)

extr_11 = Extrude(Base=boundary_13, Direction=Z_12)

num_5 = Number(number_slider_2)
number_slider_16 = Slider(0, range=0..1000)
number_slider_17 = Slider(5, range=0..10)
series_7 = Series(Start=number_slider_16, Step=Slider(60, range=0..100), Count=number_slider_17)
subtraction_4 = Subtraction(A=num_5, B=number_slider_16)

pt_4 = ConstructPoint(XCoordinate=number_slider_6, YCoordinate=series_7, ZCoordinate=0)

rectangle_8 = Rectangle(Plane=pt_4, XSize=Slider(750, range=0..10000), YSize=subtraction_4, Radius=0)  # -> Rectangle, Length

number_slider_18 = Slider(20, range=0..100)
series_8 = Series(Start=Slider(0, range=0..1000), Step=number_slider_18, Count=number_slider_17)
Z_13 = UnitZ(Factor=series_8)
move_4 = Move(Geometry=rectangle_8.Rectangle, Motion=Z_13)  # -> Geometry, Transform
Z_14 = UnitZ(Factor=number_slider_18)

boundary_14 = BoundarySurfaces(Edges=move_4.Geometry)

extr_12 = Extrude(Base=boundary_14, Direction=Z_14)

number_slider_19 = Slider(20, range=0..100)
series_9 = Series(Start=addition_2, Step=number_slider_19, Count=number_slider_10)
Z_15 = UnitZ(Factor=series_9)
move_5 = Move(Geometry=rectangle_5.Rectangle, Motion=Z_15)  # -> Geometry, Transform
Z_16 = UnitZ(Factor=number_slider_19)

boundary_15 = BoundarySurfaces(Edges=move_5.Geometry)

extr_13 = Extrude(Base=boundary_15, Direction=Z_16)

entwine_2 = Entwine(Branch00=extr_10, Branch01=extr_11, Branch02=extr_13, Branch03=extr_12, FlattenInputs=True)
sunion = SolidUnion(Breps=flatten(entwine_2))
sint = SolidIntersection(BrepsA=sunion, BrepsB=extr_5)
sdiff = SolidDifference(BrepsA=sint, BrepsB=extr_9)

material_3 = CreateMaterial(
    Diffuse=ColourSwatch(SwatchColor=RGB(255, 255, 255)),
    Specular=RGB(255, 254, 254),
    Emission=RGB(0, 0, 0),
    Transparency=Slider(0.7, range=0..1),
    Shine=0)
preview_3 = CustomPreview(Geometry=sdiff, Material=material_3)

# ==== cluster VersionCreate: 自动更新
D = ClusterInput()  # type
bang = ExplodeTree(Data=graft(D))  # -> Branch0, Branch1
T = Text(bang.Branch0)
entwine = Entwine(Branch00=bang.Branch1, Branch01=".", FlattenInputs=True)  # -> flatten(Result)
tmatch = MatchText(Text=T, Pattern=" ", Case=True)
join = TextJoin(Text=entwine)
P = ClusterInput()
p_n_c = PickNChoose(Pattern=tmatch, Stream0=T, Stream1=join)
D_2 = ClusterInput()
V = ClusterInput()
P_2 = Text(P)
V_2 = Integer(V)
D_3 = Integer(D_2)
entwine_2 = Entwine(Branch00=P_2, Branch02="Ver-", Branch03=p_n_c, Branch04=V_2, Branch05=".", Branch06=D_3, FlattenInputs=True)  # -> flatten(Result)
join_2 = TextJoin(Text=entwine_2)
R = ClusterOutput(join_2)

# ==== cluster VRayRender

timeline = VRayTimeline(FramesCount=Slider(120, range=100..200))  # -> Timeline, CurrentFrame, CurrentFraction

pt = ConstructPoint(XCoordinate=0, YCoordinate=0, ZCoordinate=0)
cosmos = VRayCosmosAsset(
    BasePlane=pt,
    Scale=Slider(0.25, range=0..0.5),
    Visible=Toggle(True),
    Lights=Toggle(True),
    IntensityMultiplier=1,
    ColorMultiplier=ColourSwatch(SwatchColor=RGB(255, 255, 255)))  # -> VGeometry, BoundingBox

stereo = Stereo(
    0,
    Has_Extract_Parameter=False,
    Has_Manage_Collection=False,
    OptionsLength=3,
    Version=1,
    Options=["Off", "Side by Side", "Top Bottom"])
type = Type(
    1,
    Has_Extract_Parameter=False,
    Has_Manage_Collection=False,
    OptionsLength=4,
    Version=1,
    Options=["Standard", "Orthographic", "VR Spherical Panorama", "VR Cube Map"])
pt_2 = ConstructPoint(XCoordinate=0, YCoordinate=0, ZCoordinate=0)
pt_3 = ConstructPoint(XCoordinate=0, YCoordinate=0, ZCoordinate=0)
camera = VRayCamera(
    Type=type,
    Stereo=stereo,
    Position=pt_2,
    Target=pt_3,
    FOV=26.99146652,
    Tilt=0,
    OrthographicZoomFactor=0,
    PhysicalExposureOn=Toggle(True),
    WhiteBalance=ColourSwatch(SwatchColor=RGB(255, 255, 255)),
    FNumber=8,
    ShutterSpeed1S=Slider(50, range=0.1..100),
    FilmSensitivity=Slider(1600, range=100..3200),
    AutoExposure=Toggle(False),
    AutoWhiteBalance=Toggle(False),
    DepthOfFieldFocus=0)  # -> Camera, Angle, ExposureValue

pt_4 = ConstructPoint(XCoordinate=0, YCoordinate=0, ZCoordinate=0)
light_directional = VRayLightDirectional(
    On=Toggle(False),
    Position=pt_4,
    Target=Point(0, 0, 0),
    Color=RGB(255, 255, 255),
    Intensity=Slider(0.25, range=0..0.5),
    ShadowSoftness=Slider(0.5, range=0..1))

texture = Texture(
    File_Picker=0,
    File_Types="All Image Files (*.png; *.bmp; *.tga; *.hdr; *.sgi; *.rgb; *.rgba; *.jpg; *.jpeg; *.exr; *.pic; *.tif; *.tiff; *.tx)|*.png;*.bmp;*.tga;*.hdr;*.sgi;*.rgb;*.rgba;*.jpg;*.jpeg;*.exr;*.pic;*.tif;*.tiff;*.tx|Portable Network Graphics (*.png)|*.png|Windows bitmap (*.bmp)|*.bmp|Targa Image (*.tga)|*.tga|Radiance High-Dynamyc Range (*.hdr)|*.hdr|Silicon Graphics (*.sgi; *.rgb; *.rgba)|*.sgi;*.rgb;*.rgba|JPEG image (*.jpg; *.jpeg)|*.jpg;*.jpeg|OpenEXR image (*.exr)|*.exr|SoftImage PICT (*.pic)|*.pic|Tagged image (*.tif; *.tiff)|*.tif;*.tiff|Tiled mipmapped image file (*.tx)|*.tx",
    Multiple_Files=True)
rig_dome = VRayLightRigDome(
    LightOn=Toggle(False),
    Visible=Toggle(False),
    Texture=texture,
    Intensity=Slider(0.03, range=0..1),
    Rotation=0,
    BackgroundIntensity=1)

graph = GraphMapper(
    timeline.CurrentFraction,
    x0=0,
    x1=1.52,
    y0=0,
    y1=1.52,
    container_name="Bezier",
    cpx=[0, 0.326005429, 0.02638938278, 1],
    cpy=[0, 0.04009175301, 0.5269581079, 1])
gradient = Gradient(
    LowerLimit=0,
    UpperLimit=1,
    Parameter=timeline.CurrentFraction,
    stops=[0: RGB(157, 255, 0), 0.485: RGB(255, 255, 0), 1: RGB(255, 0, 0)])
graph_2 = GraphMapper(
    timeline.CurrentFraction,
    x0=0,
    x1=1,
    y0=19,
    y1=24,
    container_name="Sine Summation",
    Equation0_px=[0.2, 0.4789262116],
    Equation0_py=[0.2, 0.3446460962],
    Equation1_px=[0.1866932809, 0.314386785],
    Equation1_py=[0.4049541354, 0.5476994514])
graph_3 = GraphMapper(
    graph,
    x0=0,
    x1=1.52,
    y0=-19,
    y1=16,
    container_name="Bezier",
    cpx=[0, 0.5474556684, 0.5029165149, 1],
    cpy=[1, 0.03943574429, 0.5637550354, 0.5705647469])

engine = Engine(
    2,
    Has_Extract_Parameter=False,
    Has_Manage_Collection=False,
    OptionsLength=3,
    Version=1,
    Options=["V-Ray Denoiser", "NVIDIA AI Denoiser", "Intel Open Image Denoiser"])
preset = Preset(
    2,
    Has_Extract_Parameter=False,
    Has_Manage_Collection=False,
    OptionsLength=3,
    Version=1,
    Options=["Mild", "Default", "Strong"])
mode = Mode(
    2,
    Has_Extract_Parameter=False,
    Has_Manage_Collection=False,
    OptionsLength=3,
    Version=1,
    Options=["Only Render Elements", "Hide Denoiser Channel", "Show Denoiser Channel"])
denoiser = VRayElementDenoiser(Engine=engine, Preset=preset, Mode=mode)

entwine = Entwine(FlattenInputs=True)
bang = ExplodeTree(Data=entwine)  # -> Branch0, Branch1
mtl_simple = VRayMaterialSimple(
    Diffuse={AColor=RGB(137, 137, 137), FileName="", Float=0, State=2},
    Reflection={AColor=RGB(137, 137, 137), FileName="", Float=0, State=2},
    Glossiness={AColor=RGBA(0, 0, 0, 0), FileName="", Float=0.8500000238, State=4},
    IOR=1.3,
    Opacity={AColor=RGBA(0, 0, 0, 0), FileName="", Float=1, State=4},
    Emission={AColor=RGB(0, 0, 0), FileName="", Float=0, State=2})
vgeo = VRayGeometry(Geo=bang.Branch1, Material=mtl_simple, quality=0)

mtl_name = VRayMaterialFromProject(Has_Extract_Parameter=True, Has_Manage_Collection=False, OptionsLength=0, Version=1)

vgeo_2 = VRayGeometry(Geo=bang.Branch0, Material=mtl_name, quality=0)

entwine_2 = Entwine(Branch00=vgeo_2, Branch01=vgeo, Branch02=cosmos.VGeometry, FlattenInputs=True)

out_img = OutputImage(
    "C:\Users\yukio\Desktop\CubeRender\cube_render.png",
    File_Picker=1,
    File_Types="Portable Network Graphics (*.png)|*.png|Windows bitmap (*.bmp)|*.bmp|Targa Image (*.tga)|*.tga|Radiance High-Dynamyc Range (*.hdr)|*.hdr|Silicon Graphics (*.sgi; *.rgb; *.rgba)|*.sgi;*.rgb;*.rgba|JPEG image (*.jpg; *.jpeg)|*.jpg;*.jpeg|OpenEXR image (*.exr)|*.exr|SoftImage PICT (*.pic)|*.pic|Tagged image (*.tif; *.tiff)|*.tif;*.tiff|Tiled mipmapped image file (*.tx)|*.tx|V-Ray Raw Image (*.vrimg)|*.vrimg",
    Multiple_Files=False)
sampler = Sampler(
    0,
    Has_Extract_Parameter=False,
    Has_Manage_Collection=False,
    OptionsLength=2,
    Version=1,
    Options=["Progressive", "Bucket"])
quality = Quality(
    0,
    Has_Extract_Parameter=False,
    Has_Manage_Collection=False,
    OptionsLength=6,
    Version=1,
    Options=["Low", "Low+", "Medium", "Medium+", "High", "High+"])
engine_2 = Engine(0, Has_Extract_Parameter=False, Has_Manage_Collection=False, OptionsLength=3, Version=1, Options=["CPU", "CUDA", "RTX"])
mode_2 = Mode(
    0,
    Has_Extract_Parameter=False,
    Has_Manage_Collection=False,
    OptionsLength=2,
    Version=1,
    Options=["Interactive", "Production"])
repeat = RepeatData(Data=Slider(480, range=240..2048), Length="2")
render = VRayRender(
    Engine=engine_2,
    Mode=mode_2,
    Sampler=sampler,
    Quality=quality,
    OutputImage=out_img,
    OutputResolution=repeat,
    Camera=camera.Camera,
    LightRig=rig_dome,
    Light=flatten(light_directional),
    VGeometry=flatten(entwine_2),
    Timeline=timeline.Timeline,
    RenderElements=denoiser,
    UpdateEffectsFrequency=100)

render_in_project = VRayRenderInProject(Scene=render)  # disabled
